# Grasshopper definition example_plates.gh (Grasshopper 1.0.7)
# plug-ins: CadworkGrasshopper

selectbrep = SelectBrep(cwBreps="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")
selectbrep_2 = SelectBrep(cwBreps="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")

# ----
# Get Contact Face/Curve
expression = Expression(Expression="-1")
shift_list = ShiftList(List=flatten(selectbrep), Shift=0, Wrap=True)
shift_list_2 = ShiftList(List=flatten(selectbrep), Shift=expression, Wrap=True)
brep_brep = BrepBrep(BrepA=shift_list_2, BrepB=shift_list)  # -> flatten(Curves), Points

explode = Explode(Curve=brep_brep.Curves, Recursive=True)  # -> Segments, Vertices

point = Point(explode.Vertices)
deconstruct = Deconstruct(Point=point)  # -> XComponent, YComponent, ZComponent
sort_list = SortList(Keys=deconstruct.ZComponent, ValuesValuesA=point)  # -> Keys, ValuesValuesA
cull_duplicates = CullDuplicates(Points=sort_list.ValuesValuesA, Tolerance=0.1, CullMode=3)  # -> Points, Indices, Valence

selectbrep_3 = SelectBrep(cwBreps="[null]")

list_item = ListItem(List=cull_duplicates.Points, Index=0, Wrap=True)  # -> Item2, Item1, Item
vector_2pt = Vector2Pt(PointA=list_item.Item2, PointB=list_item.Item1, Unitize=False)  # -> Vector, Length
vector_2pt_2 = Vector2Pt(PointA=list_item.Item2, PointB=list_item.Item1, Unitize=True)  # -> Vector, Length

axis = Axis(cwSelectedAxis=[-1, 0, 0, 0, 0, 1])  # -> OutputAxis, VectorXLocal, VectorZLocal
panel = Panel(axis.OutputAxis)

rotate = Rotate(Geometry=vector_2pt_2.Vector, Angle=degrees(Slider(90, range=0..100)), Plane=PlaneXY(0, 0, 0))  # -> Geometry, Transform
cross_product = CrossProduct(VectorA=vector_2pt_2.Vector, VectorB=rotate.Geometry, Unitize=False)  # -> simplify(Vector), Length
construct_plane = ConstructPlane(Origin=list_item.Item2, XAxis=rotate.Geometry, YAxis=cross_product.Vector)

number_slider = Slider(260, range=0..1000)
number_slider_2 = Slider(27, range=0..100)
construct_domain = ConstructDomain(DomainStart=expr("x * 0.5", number_slider), DomainEnd=expr("x * -0.5", number_slider))
expression_2 = Expression(x=number_slider_2, Expression="x * -1")
rectangle = Rectangle(Plane=construct_plane, XSize=construct_domain, YSize=expression_2, Radius=0)  # -> Rectangle, Length
multiplication = Multiplication(A=vector_2pt_2.Vector, B=vector_2pt.Length)
extrude = Extrude(Base=rectangle.Rectangle, Direction=multiplication)
cap_holes = CapHoles(Brep=extrude)  # -> flatten(Brep)

deconstruct_plane = DeconstructPlane(Plane=construct_plane)  # -> Origin, XAxis, YAxis, ZAxis
plane = Plane(construct_plane)
multiplication_2 = Multiplication(A=deconstruct_plane.XAxis, B=Slider(50, range=0..100))
move = Move(Geometry=plane, Motion=expr("x * -1", multiplication_2))  # -> Geometry, Transform
move_2 = Move(Geometry=plane, Motion=multiplication_2)  # -> Geometry, Transform
number_slider_3 = Slider(-100, range=-100..100)
line_sdl = LineSDL(Start=[move.Geometry, move_2.Geometry], Direction=vector_2pt_2.Vector, Length=vector_2pt.Length)

list_length = ListLength(List=cap_holes)
series = Series(Start=0, Step=1, Count=list_length)
repeat_data = RepeatData(Data="Lasche_", Length=list_length)
concatenate = Concatenate(FragmentA=repeat_data, FragmentB=series)
panel_2 = Panel(concatenate)

extend_curve = ExtendCurve(Curve=line_sdl, Type=0, Start=number_slider_3, End=number_slider_3)
divide_distance = DivideDistance(Curve=extend_curve, Distance=Slider(250, range=0..1000))  # -> Points, Tangents, Parameters
multiplication_3 = Multiplication(A=number_slider_2, B=cross_product.Vector)
move_3 = Move(Geometry=divide_distance.Points, Motion=expr("x * -1", multiplication_3))  # -> Geometry, Transform
drilling = Drilling(Point_1=flatten(divide_distance.Points), Point_2=flatten(move_3.Geometry), Diameter=Slider(5, range=0..10))
stdattr = StdAttr(Color=Slider(12, range=0..12))
axis_2 = Axis(VectorXLocal=vector_2pt_2.Vector, VectorZLocal=cross_product.Vector)  # -> flatten(OutputAxis), VectorXLocal, VectorZLocal
cwattr = CwAttr(Name=concatenate, User199=flatten(["01: Hallo", "02: Welt"]))
panel_3 = Panel(Geom=cap_holes, Axis=axis_2.OutputAxis, CwAttr=cwattr, StdAttr=stdattr)
